vi "index.gviweb"   [G Web Development Software 22.3.0]
panel controls:
  "selector": bool
panel indicators:
  "body": string
  "error out": error
  "current time": timestamp
uses:
  NI::HTTP::POST Buffer.gvi
diagram:
  # Place setup code before the loop. For example, perform initial data communication and wire the results into the loop.
  # Top-Level WebVIs usually contain a While Loop that never stops so that they can continue running as long as the web page is open in the user's web browser.
  while {
    case ($selector) {
      frame False, Default { }
      frame True {
        call "POST Buffer.gvi"(url="WebService/CSM-RunScript", buffer="API: API1 -@ CSM") -> (body=w1, error out=w2)
        $body <- w1
        Get Current Time() -> (current time=w3)
        $"current time" <- w3
        $"error out" <- w2
      }
    }
    Wait(time to wait=50)
    stop if FALSE
  }
